# Grasshopper definition Paperhopper_2_PLAY_TEMPLATE.gh (Grasshopper 1.0.7)
# plug-ins: Human, gHowl, Telepathy

# PaperHopper
# github.com/dantaeyoung/paperhopper
# Dan Taeyoung / @dantaeyoung
# Receive and calibrate data from Reactivision based on `calibration.xml`
# If this doesn't work, follow these instructions:
listentoreactivision = BooleanToggle(True)
filter = StreamFilter(Gate=listentoreactivision, Stream1="3333")
udp = UDPReceiver(Port=filter, Pattern="999")  # -> Info, Data
gs_loadcalibrationdata = GSLoadCalibrationData(update=Button())  # -> calibrationmmv, calibrationadjustment
troubleshoot = Troubleshoot(T=udp.Info)
playspacerectangle = Geometry(<curve referenced from the Rhino model>)
# SETUP
panel = Panel(troubleshoot)
playspacerectangle_2 = RemoteSender(playspacerectangle)
playspacerectangle_3 = RemoteReceiver(playspacerectangle_2)
calibrationreactivision = CalibrationReactivision(
    reset=Button(),
    data=udp.Data,
    mmv=gs_loadcalibrationdata.calibrationmmv,
    calibrationadjustment=gs_loadcalibrationdata.calibrationadjustment)  # -> rawplanes_2, rawanglesfrom0to1_2, calibratedids_2, calibratedplanes, calibratedangles, timestamp
custom_preview_lineweights = CustomPreviewLineweights(
    Geometry=playspacerectangle_3,
    Shader=ColourSwatch(SwatchColor=RGB(255, 255, 255)),
    Thickness=Slider(3, range=0..10),
    Absolute=False)
calibratedplanes = RemoteSender(calibrationreactivision.calibratedplanes)
calibratedplanes_2 = RemoteReceiver(calibratedplanes)
circle = Circle(Plane=calibratedplanes_2, Radius=Slider(10, range=0..100))
custom_preview = CustomPreview(Geometry=circle, Material=ColourSwatch(SwatchColor=RGB(34, 97, 7)))
calibrationtimestamp = RemoteSender(calibrationreactivision.timestamp)
calibratedangles = RemoteSender(calibrationreactivision.calibratedangles)
calibratedids = RemoteSender(calibrationreactivision.calibratedids_2)
rawanglesfrom0to1 = RemoteSender(calibrationreactivision.rawanglesfrom0to1_2)
rawplanes = RemoteSender(calibrationreactivision.rawplanes_2)
# You must run this file after calibration!
# 
# If you haven't calibrated, close this file, then open
# 'Paperhopper_1_CALIBRATION.gh'.
# 
# If you have calibrated: Great! Save this file as a new file, then start playing.
panel_2 = Panel(rawanglesfrom0to1)

turn_on_debug = BooleanToggle(False)
calibratedplanes_3 = RemoteReceiver(calibratedplanes)
stream_filter = StreamFilter(Gate=turn_on_debug, Stream1=calibratedplanes_3)
projectionscale_rhinooverirl = RemoteReceiver()
md_slider = MDSlider(
    SliderMode=0,
    slider_value=Point(0.9360868078, 0.6700220353, 0.5),
    x_domain=Domain(-30, 30),
    y_domain=Domain(-30, 30),
    z_domain=Domain(0, 1))
calibratedangles_2 = RemoteReceiver(calibratedangles)
deconstruct_plane = DeconstructPlane(Plane=stream_filter)  # -> Origin, XAxis, YAxis, ZAxis
number_slider = Slider(55, range=0..100)
calibratedids_2 = RemoteReceiver(calibratedids)
move = Move(Geometry=deconstruct_plane.Origin, Motion=md_slider)  # -> Geometry, Transform
deconstruct = Deconstruct(Point=deconstruct_plane.Origin)  # -> XComponent, YComponent, ZComponent
multiplication = Multiplication(A=projectionscale_rhinooverirl, B=Slider(0.7, range=0..4))
degrees = Degrees(Radians=calibratedangles_2)
line_sdl = LineSDL(Start=deconstruct_plane.Origin, Direction=deconstruct_plane.YAxis, Length=number_slider)
line_sdl_2 = LineSDL(Start=deconstruct_plane.Origin, Direction=deconstruct_plane.XAxis, Length=number_slider)
concatenate = Concatenate(
    FragmentH="ID: ",
    FragmentG=calibratedids_2,
    FragmentF="x: ",
    FragmentA=deconstruct.XComponent,
    FragmentB=", y: ",
    FragmentC=deconstruct.YComponent,
    FragmentD="rot: ",
    FragmentE=degrees)
# Undo / Redo
gradient = Gradient(
    LowerLimit="0",
    UpperLimit="360",
    Parameter=degrees,
    stops=[0: RGB(243, 57, 0), 0.1: RGB(236, 27, 60), 0.2: RGB(210, 0, 118), 0.3: RGB(103, 0, 120), 0.4: RGB(39, 72, 161), 0.5: RGB(1, 192, 229), 0.6: RGB(18, 178, 90), 0.7: RGB(79, 186, 8), 0.8: RGB(220, 237, 32), 0.9: RGB(247, 159, 20), 1: RGB(243, 57, 0)])
geometry = Geometry([line_sdl_2, line_sdl])
# DRWG
text_tag_3d = TextTag3D(Location=move.Geometry, Text=concatenate, Size=Slider(6, range=0..100), Colour=gradient, Justification=7)
custom_preview_lineweights_2 = CustomPreviewLineweights(
    Geometry=geometry,
    Shader={diffuse=RGB(255, 105, 180), emission=RGB(76, 32, 54), shine=0.5, specular=RGB(255, 255, 255), transparency=0},
    Thickness=Slider(6, range=0..10),
    Absolute=False)

calibratedplanes_4 = RemoteReceiver(calibratedplanes)
turn_on_blobs = BooleanToggle(False)
stream_filter_2 = StreamFilter(Gate=turn_on_blobs, Stream1=calibratedplanes_4)
# DEMOS
delaunay_edges = DelaunayEdges(Points=flatten(stream_filter_2), Plane=PlaneXY(0, 0, 0))  # -> Connectivity, Edges
metaball_t = MetaBallT(Points=flatten(stream_filter_2), Plane=PlaneXY(0, 0, 0), Threshold=Slider(0.002, range=0..0.003))
length = Length(Curve=metaball_t)
trim_with_regions = TrimWithRegions(Curve=delaunay_edges.Edges, Regions=metaball_t)  # -> Inside, Outside
geometry_2 = Geometry(trim_with_regions.Outside)
gradient_2 = Gradient(
    LowerLimit=0,
    UpperLimit=Slider(1867, range=0..100000),
    Parameter=length,
    stops=[0: RGB(243, 57, 0), 0.1: RGB(236, 27, 60), 0.2: RGB(210, 0, 118), 0.3: RGB(103, 0, 120), 0.4: RGB(39, 72, 161), 0.5: RGB(1, 192, 229), 0.6: RGB(18, 178, 90), 0.7: RGB(79, 186, 8), 0.8: RGB(220, 237, 32), 0.9: RGB(247, 159, 20), 1: RGB(243, 57, 0)])
custom_preview_lineweights_3 = CustomPreviewLineweights(
    Geometry=geometry_2,
    Shader=ColourSwatch(SwatchColor=RGB(189, 111, 111)),
    Thickness=Slider(10, range=0..10),
    Absolute=False)
custom_preview_lineweights_4 = CustomPreviewLineweights(Geometry=metaball_t, Shader=gradient_2, Thickness=Slider(10, range=0..10), Absolute=False)

# ----
# Use this component to find tags based on tag ID!
rawanglesfrom0to1_2 = RemoteReceiver(rawanglesfrom0to1)
calibratedplanes_5 = RemoteReceiver(calibratedplanes)
calibratedids_3 = RemoteReceiver(calibratedids)
# This file requires several crucial plugins:
# - Human
# - gHowl
# - Lunchbox
# - Telepathy
# - Bengesht
# If you see errors, then load the plugins into Grasshopper, then close without saving and reopen this file. The plugins are conveniently collected in the gh_plugins folder.
# PLAY
panel_3 = Panel("0")
# Find tags based on tag ID
ph_find_tags_v4 = PHFindTagsV4(
    tag_id=panel_3,
    calibratedids=calibratedids_3,
    calibratedplanes=calibratedplanes_5,
    rawanglesfrom0to1=rawanglesfrom0to1_2)  # -> tag_id_exists_2, calibrated_planes_2, anglefrom0to1_2
panel_4 = Panel(ph_find_tags_v4.calibrated_planes_2)
panel_5 = Panel(ph_find_tags_v4.tag_id_exists_2)
panel_6 = Panel(ph_find_tags_v4.anglefrom0to1_2)

# ==== cluster CalibrationReactivision
data = ClusterInput()
reactivision_osc_to_planes = ReactivisionOscToPlanes(data=data)  # -> id_2, pln_2, angle_2
planes = Plane(reactivision_osc_to_planes.pln_2)
angles = Number(reactivision_osc_to_planes.angle_2)
ids = Number(reactivision_osc_to_planes.id_2)
reset = ClusterInput()
getallkeysseensofar = GetAllKeysSeenSoFar(reset=reset, ids=ids)  # -> simplify(graft(allkeys))
equals = Equality(FirstNumber=getallkeysseensofar, SecondNumber=ids)  # -> Equality, Inequality
dispatch = Dispatch(List=angles, DispatchPattern=equals.Equality)  # -> graft(ListA), ListB
dispatch_2 = Dispatch(List=planes, DispatchPattern=equals.Equality)  # -> graft(ListA), ListB

calibratedids = Number(simplify(getallkeysseensofar))
rawplanes = Plane(simplify(dispatch_2.ListA))
rawangles = Number(simplify(dispatch.ListA))

calibrationadjustment = ClusterInput()
mmv = ClusterInput()
division = Division(A=rawangles, B="Pi * 2")
rawplanes_2 = ClusterOutput(rawplanes)
calibratedids_2 = ClusterOutput(calibratedids)
rawanglesfrom0to1 = Number(simplify(division))
calibration = Calibration(uncalibratedflatplane=rawplanes, mmv=mmv, T=calibrationadjustment)  # -> pl, A
gettimestamp = GetTimestamp()
python = GhPythonScript(input=data)  # -> out, timestamp; inputs input: tree
# ---------- python: Python ----------
import time
timestamp = int(round(time.time()))
# ---------- end python ----------
rawanglesfrom0to1_2 = ClusterOutput(rawanglesfrom0to1)
calibratedplanes = ClusterOutput(calibration.pl)
calibratedangles = ClusterOutput(calibration.A)
timestamp = ClusterOutput(python.timestamp)

# ==== cluster Troubleshoot
panel = Panel("""It looks like you have another Grasshopper definition that's listening to Reactivision! 

1. Close the other definition
2. Delete the ">UDP<" component
3. Hit Ctrl-Z to undo

This should work!""")
T = ClusterInput()
tmatch = MatchText(Text=T, Pattern="*new message*", Case=True)
tmatch_2 = MatchText(Text=T, Pattern="AddressAlreadyInUse*", Case=True)
filter = StreamFilter(Gate=tmatch, Stream1="Looks like everything is working great!")
filter_2 = StreamFilter(Gate=tmatch_2, Stream1=panel)
concat = Concatenate(FragmentA=filter_2, FragmentB=filter)
message = Text(concat)
message_2 = ClusterOutput(message)

# ==== cluster GSLoadCalibrationData
optional_filename = ClusterInput()
update = ClusterInput()
readcalibrationfile = ReadCalibrationFile(update=update, _0=optional_filename)
decodecalibrationdata = DecodeCalibrationData(jsondump=readcalibrationfile)  # -> calibrationmmv_2, calibrationadjustment_2
calibrationmmv = ClusterOutput(decodecalibrationdata.calibrationmmv_2)
calibrationadjustment = ClusterOutput(decodecalibrationdata.calibrationadjustment_2)

# ==== cluster PHFindTagsV4
calibratedplanes = ClusterInput()
calibratedids = ClusterInput()
rawanglesfrom0to1 = ClusterInput()
tag_id = ClusterInput()
calibratedplanes_2 = RemoteReceiver(calibratedplanes)
calibratedids_2 = RemoteReceiver(calibratedids)
rawanglesfrom0to1_2 = Number(rawanglesfrom0to1)
tag_id_2 = Number(tag_id)
equality = Equality(FirstNumber=graft(tag_id_2), SecondNumber=simplify(flatten(calibratedids_2)))  # -> Equality, Inequality
tree_statistics = TreeStatistics(Tree=calibratedids_2)  # -> Paths, Length, Count
dispatch = Dispatch(List=tree_statistics.Paths, DispatchPattern=equality.Equality)  # -> ListA, ListB
tree_branch = TreeBranch(Tree=calibratedids_2, Path=dispatch.ListA, MaintainPaths=True)
tree_branch_2 = TreeBranch(Tree=calibratedplanes_2, Path=dispatch.ListA, MaintainPaths=True)
tree_branch_3 = TreeBranch(Tree=rawanglesfrom0to1_2, Path=dispatch.ListA, MaintainPaths=True)
null_item = NullItem(Item=tree_branch_3)  # -> NullFlags, InvalidFlags, Description
gate_not = GateNot(A=null_item.NullFlags)
deconstruct_plane = DeconstructPlane(Plane=tree_branch_2)  # -> Origin, XAxis, YAxis, ZAxis
unit_x = UnitX(Factor=1)
tag_id_exists = Boolean(gate_not)
calibrated_planes = Plane(tree_branch_2)
angle = Angle(VectorA=unit_x, VectorB=deconstruct_plane.XAxis)  # -> Angle, Reflex
tag_id_exists_2 = ClusterOutput(tag_id_exists)
division = Division(A=angle.Angle, B="Pi")
calibrated_planes_2 = ClusterOutput(calibrated_planes)
anglefrom0to1 = Number(tree_branch_3)
anglefrom0to1_2 = ClusterOutput(anglefrom0to1)

# ==== cluster GetAllKeysSeenSoFar
reset = ClusterInput()
ids = ClusterInput()
getallkeysseensofar = GhPythonScript(reset=reset, ids=ids)  # -> out, allkeys; inputs ids: list of Int32
# ---------- getallkeysseensofar: Python ----------
import scriptcontext

if reset or "ids" not in scriptcontext.sticky:
    scriptcontext.sticky["ids"] = {}


for id in ids:
    scriptcontext.sticky["ids"][id] = True
    
allkeys = sorted(scriptcontext.sticky["ids"].keys())
# ---------- end getallkeysseensofar ----------
allkeys = ClusterOutput(getallkeysseensofar.allkeys)

# ==== cluster ReactivisionOscToPlanes
data = ClusterInput()
data_2 = Data(data)
lng = ListLength(List=data_2)
series = Series(Start=0, Step=1, Count=lng)
tmatch = MatchText(Text=data_2, Pattern="set", Case=True)
dispatch = Dispatch(List=series, DispatchPattern=tmatch)  # -> ListA, ListB
item = ListItem(List=data_2, Index=dispatch.ListA, Wrap=True)  # -> Item, Item1, Item2, Item3, Item4, Item5
pt = ConstructPoint(XCoordinate=item.Item3, YCoordinate=item.Item4, ZCoordinate=0)
xy = XYPlane(Origin=pt)
prot = RotatePlane(Plane=xy, Angle=item.Item5)
angle = Number(item.Item5)
pln = Plane(prot)
id = Number(item.Item2)
id_2 = ClusterOutput(id)
pln_2 = ClusterOutput(pln)
angle_2 = ClusterOutput(angle)

# ==== cluster Calibration
uncalibratedflatplane = ClusterInput()
mmv = ClusterInput()
uncalibratedflatplane_2 = Plane(uncalibratedflatplane)
calibrationwithmmv = CalibrationWithMMV(pts=uncalibratedflatplane_2, mmv=mmv)
T = ClusterInput()
move = Move(Geometry=calibrationwithmmv, Motion=T)  # -> Geometry, Transform
pl_origin = PlaneOrigin(Base=uncalibratedflatplane_2, Origin=move.Geometry)
xy = XYPlane(Origin=Point(0, 0, 0))
deplane = DeconstructPlane(Plane=pl_origin)  # -> Origin, XAxis, YAxis, ZAxis
X = UnitX(Factor=1)
angle = Angle(VectorA=X, VectorB=deplane.XAxis, Plane=xy)  # -> Angle, Reflex
pl = ClusterOutput(pl_origin)
A = ClusterOutput(angle.Angle)

# ==== cluster GetTimestamp: #GetTimestamp
input = ClusterInput()
python = GhPythonScript(input=input)  # -> out, timestamp
# ---------- python: Python ----------
import time
timestamp = int(round(time.time() ))
# ---------- end python ----------
timestamp = ClusterOutput(python.timestamp)

# ==== cluster DecodeCalibrationData
jsondump = ClusterInput()
b64dump = ClusterInput()
deserializedata = DEserializeData(jsondump=jsondump, b64dump=b64dump)  # -> keys, vals
bang = ExplodeTree(Data=deserializedata.vals)  # -> Branch0, Branch1
calibrationadjustment = Point(bang.Branch1)
calibrationmmv = Number(bang.Branch0)
calibrationmmv_2 = ClusterOutput(calibrationmmv)
calibrationadjustment_2 = ClusterOutput(calibrationadjustment)

# ==== cluster ReadCalibrationFile
update = ClusterInput()
_0 = ClusterInput()
update_2 = Data(update)
gh_filepath = GHFilepath()  # -> filepath, filedir
combine = CombineData(Input0=_0, Input1="calibration.csv")  # -> Result, Index
writecalibrationfile = GhPythonScript(update=update_2, filedir=gh_filepath.filedir, filename=combine.Result)  # -> out, jsondump
# ---------- writecalibrationfile: Python ----------
import ghpythonlib.treehelpers as th
import json
import os 


filepath = os.path.join(filedir, filename)

print filepath

with open(filepath, "r") as f:
    jsondump = f.read()
# ---------- end writecalibrationfile ----------
jsondump = ClusterOutput(writecalibrationfile.jsondump)
panel = Panel(writecalibrationfile.jsondump)

# ==== cluster CalibrationWithMMV
mmv = ClusterInput()
pts = ClusterInput()
python = GhPythonScript(pts=pts, MMV=mmv)  # -> out, xs, ys, respt; inputs pts: list of Point3d, MMV: list
# ---------- python: Python ----------
from itertools import product

 
 
def multiply(matr_a, matr_b):
    """Return product of an MxP matrix A with an PxN matrix B."""
    cols, rows = len(matr_b[0]), len(matr_b)
    resRows = xrange(len(matr_a))
    rMatrix = [[0] * cols for _ in resRows]
    for idx in resRows:
        for j, k in product(xrange(cols), xrange(rows)):
            rMatrix[idx][j] += matr_a[idx][k] * matr_b[k][j]
    return rMatrix


xs = []
ys = []
for pt in pts:
    d = [[pt.X, pt.Y, 1]]
    MM = [[MMV[0], MMV[1], MMV[2]], [MMV[3], MMV[4], MMV[5]], [MMV[6], MMV[7], MMV[8]]]
    res = multiply(d, MM)[0]
    x = res[0] / res[2]
    y = res[1] / res[2]
    
    xs.append(x)
    ys.append(y)
    respt = (x, y, 0)
# ---------- end python ----------
pt = ConstructPoint(XCoordinate=python.xs, YCoordinate=python.ys, ZCoordinate=0)
topoint = ClusterOutput(pt)

# ==== cluster DEserializeData
jsondump = ClusterInput()
b64dump = ClusterInput()
or = ClusterInput()
or_2 = Data(or)
python = GhPythonScript(jsondump=jsondump, b64dump=b64dump)  # -> out, keys, vals
# ---------- python: Python ----------
import ghpythonlib.treehelpers as th
import json
import base64


thisjsondump = jsondump
if(b64dump):
    thisjsondump = base64.b64decode(b64dump)

d = json.loads(thisjsondump)
keys = th.list_to_tree(d["keys"])
vals = th.list_to_tree(d["vals"])
# ---------- end python ----------
vals = ClusterOutput(python.vals)
keys = ClusterOutput(python.keys)

# ==== cluster GHFilepath
get_gh_filepath = GetGHFilepath()  # -> filepath, filedir
filedir = ClusterOutput(get_gh_filepath.filedir)
panel = Panel(get_gh_filepath.filepath)
filepath = ClusterOutput(get_gh_filepath.filepath)

# ==== cluster GetGHFilepath
get_gh_filepath = GhPythonScript()  # -> out, filepath, filedir
# ---------- get_gh_filepath: Python ----------
import os


thisdoc = ghenv.Component.OnPingDocument()

while thisdoc.FilePath is None:
    #we are inside a cluster
    thisdoc = thisdoc.Owner.OwnerDocument()

filepath = thisdoc.FilePath
filedir = os.path.dirname(filepath)
# ---------- end get_gh_filepath ----------
filedir = ClusterOutput(get_gh_filepath.filedir)
filepath = ClusterOutput(get_gh_filepath.filepath)
